# Grasshopper definition DynamicRelaxation.gh (Grasshopper 0.9.61)
# plug-ins: Python Interpreter

# This is some geometry from Rhino
crv = Curve(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)
pt = Point([Point(0, 0, 0), Point(15, 0, 0)])
# The names you give the input/output parameters, are accessible within the script (you do not need to declare anything)
subdiv = Slider(8, range=0..24)
step_size = Slider(1824.635, range=1..5000)
reset = BooleanToggle(False)
timer = Timer(TimerInterval=2, Target=dynamic_relaxation_engine)
# Also, if you right click an input parameter you can tell python what type of variable it is using the 'type hint' in the bottom
run = BooleanToggle(True)
dynamic_relaxation_engine = PythonScript(curveIn=crv, supportPtsIn=pt, subDiv=subdiv, run=run, reset=reset, step=step_size)  # -> out, curveOut, bendedCrv, curvePoints; inputs curveIn: Curve, supportPtsIn: list of Point3d, subDiv: Int32
# ---------- dynamic_relaxation_engine: Python ----------
import Rhino # this is all the Rhino common classes and stuff (documentation here: http://4.rhino3d.com/5/rhinocommon/)
#import rhinoscriptsyntax as rs

import sys

import DynamicRelaxation


"""This component takes as input different sets of lines to define a dynamic relaxation (DR) process to find their equilibrium position.


This is the first example of a (hopefully) running code.

There are of course several things that need to be done:
    
    TODO allow for different materials in same kind of elements (e.g. tow different bending stiffnesses) maybe as pairs sets [ [list,material],[otherlist]other material]]
    TODO have a way to define generic materials (young modulus E + section area A + second moment of inertia I)(as a python class?)
    TODO add load elements as triple [position, direction, value]

The code is heavily inspired by the TraerPhysics library for Processing by J. Traer and several amendments/improvements 
made by Guillaume Labelle and Julien Nembrini in TraerAnar as a link to the ANAR+ library (http://anar.ch) 

This code is copyrighted by Julien Nembrini and distributed open source in the sense of the Gnu GPL v3.0. 

"""

#@@@@@@@@@@@@@@@@@@@@@@@@@@@@@@@
#@@@@@@@@@@@@@@@@@@@@@@@@@@@@@@@
#@@@@@@@@@@@@@@@@@@@@@@@@@@@@@@@
#@@@@@@@@@@@@@@@@@@@@@@@@@@@@@@@

print 'A prototype for dynamic relaxation in Rhino/GH/python. (c) Julien Nembrini'

#print sys.path

if reset :
    
    pts = []
    for i in range(0,subDiv+1):
        crvPt = Rhino.Geometry.Curve.PointAt(curveIn, curveIn.Domain[1]/subDiv * i)
        pts.append(crvPt)
    
    # create particle system no drag no gravity
    ps = DynamicRelaxation.ParticleSystem()
    #ps = ParticleSystem(Vector3D(0,0,1), 0.5)
    #ps.setIntegrator(ParticleSystem.EULER)
    print ps
    #print pts
    
    for p in pts:
        ps.makeParticle(p.X,p.Y,p.Z)
    
    particles = ps.particles
    
    #for p in particles:
    #    print p
    
    print len(particles)
    
    #create the bending elements (registered automagically in ps)
    for i in range(len(particles)-2):
        ps.makeBending(particles[i],particles[i+1],particles[i+2],28000e06,7e-09,2.01062e-04)
    
    #for i in range(len(particles)-1):
    #    ps.makeSpring(particles[i],particles[i+1],10,0)
    
        
    # fix particles at the ends
    particles[0].makeFixed()
    particles[-1].makeFixed()
    
    
    
    for p in particles:
        print p
    
    

#@@@@@@@@@@@@@@@@@@@@@@@@@@@@@@@
#@@@@@@@@@@@@@@@@@@@@@@@@@@@@@@@
#@@@@@@@@@@@@@@@@@@@@@@@@@@@@@@@
#@@@@@@@@@@@@@@@@@@@@@@@@@@@@@@@


if run:
    for i in range(10):
        #ps.step(step)
        ps.stepRelax(step)


#@@@@@@@@@@@@@@@@@@@@@@@@@@@@@@@
#@@@@@@@@@@@@@@@@@@@@@@@@@@@@@@@
#@@@@@@@@@@@@@@@@@@@@@@@@@@@@@@@
#@@@@@@@@@@@@@@@@@@@@@@@@@@@@@@@

#center = Rhino.Geometry.Point3d((supportPtsIn[0].X + supportPtsIn[1].X) * .5, (supportPtsIn[0].Y + supportPtsIn[1].Y) * .5, (supportPtsIn[0].Z + supportPtsIn[1].Z) * .5)
parts = []

for p in ps.particles:
    part = Rhino.Geometry.Point3d(p.position.x(), p.position.y(), p.position.z())
    parts.append(part)
   

bendedCrv = Rhino.Geometry.PolylineCurve(parts)
  
curvePoints = parts
curveOut = Rhino.Geometry.PolylineCurve(pts)
# ---------- end dynamic_relaxation_engine ----------
pt_2 = Point(dynamic_relaxation_engine.curvePoints)
crv_2 = Curve(dynamic_relaxation_engine.curveOut)
crv_3 = Curve(dynamic_relaxation_engine.bendedCrv)
panel = Panel(dynamic_relaxation_engine.out)
